% Simulink data dictionary EPOS4.sldd

x520886_fDIncrEnc = Simulink.Parameter(6250000, DataType="double", Min=0, Max=6250000, Unit="Hz")  % For

x520886_TsCur = Simulink.Parameter(0.04, DataType="double", Unit="ms")  % During a movement within a drive system, forces and/or torques must be controlled.
  % Therefore, as a principal regulation structure, EPOS4 offers current-based control
  % For more information, visit EPOS4 Application Notes Collection Edition 2021-03

x520886_ICont = Simulink.Parameter(15, DataType="double", Min=-30, Max=30, Unit="A")  % Continuous output current
  % For more information, visit EPOS4 Application Notes Collection Edition 2021-03

x520886_TsPos = Simulink.Parameter(0.04, DataType="double", Unit="ms")  % During a movement within a drive system, forces and/or torques must be controlled.
  % Therefore, as a principal regulation structure, EPOS4 offers current-based control
  % For more information, visit EPOS4 Application Notes Collection Edition 2021-03