% Simulink data dictionary ExoskeletonParameters.sldd

ExoskeletonSignal = Simulink.Bus()
  Left: Bus: LegSignal
  Right: Bus: LegSignal

LegSignal = Simulink.Bus()
  Hip: Bus: RespSignal
  Knee: Bus: RespSignal
  Ankle: Bus: RespSignal

RespSignal = Simulink.Bus()
  Angle: double
  Speed: double
  Torque: double