% Simulink data dictionary HarmonicDrive.sldd

x28_000006_TNom = Simulink.Parameter(24, Max=39)  % Nominal torque at 2000 rpm
  % https://www.hiwin.de/en/Products/Strain-wave-gears/DATORKER%C2%AE-WUT-S-PO/WUT-S-17-100-PO/p/28-000006

x28_000006_TCollision_Nm = 108
x28_000006_TPeak_Nm = 54
x28_000006_vMaxAvg_rpm = 3500
x28_000006_reduction = 100
x28_000006_vMaxIn_rpm = 7300