% Simulink data dictionary MotorInfo.sldd
% references EPOS4.sldd
% references ExoskeletonParameters.sldd
% references HarmonicDrive.sldd

x607325_RotInd = Simulink.Parameter(0.109, Unit="mH")  % Terminal inductance
  % Reference:
  % https://www.maxongroup.com/maxon/view/product/607325

x607325_Res = Simulink.Parameter(0.109, Unit="Ω")  % Terminal resistance
  % Reference:
  % https://www.maxongroup.com/maxon/view/product/607325

x607325_VNom = Simulink.Parameter(18, Unit="V")  % Nominal voltage
  % Reference:
  % https://www.maxongroup.com/maxon/view/product/607325

x607325_Eff = Simulink.Parameter(0.86)  % Max. efficiency
  % Reference:
  % https://www.maxongroup.com/maxon/view/product/607325

x607325_RotOmg = Simulink.Parameter(1770, Min=0, Max=2100, Unit="rpm")  % Nominal speed
  % Max = no load speed
  % Reference:
  % https://www.maxongroup.com/maxon/view/product/607325

x607325_Curr = Simulink.Parameter(12.1, Min=0.83, Max=166, Unit="A")  % Nominal current (max. continuous current)
  % Min = No load current
  % Max = Stall current
  % Reference:
  % https://www.maxongroup.com/maxon/view/product/607325

x607325_TorqConst = Simulink.Parameter(80.7, Unit="mN*m/A")  % Torque constant
  % Reference:
  % https://www.maxongroup.com/maxon/view/product/607325

x607325_SpeedConst = Simulink.Parameter(118, Unit="rpm/V")  % Speed constant
  % Reference:
  % https://www.maxongroup.com/maxon/view/product/607325

x607325_Speed_TorqGrad = Simulink.Parameter(0.159, Unit="rpm/(mN*m)")
x607325_MechTimeConst = Simulink.Parameter(8.45, Unit="ms")

x607325_Torq = Simulink.Parameter(1010, Min=0, Max=13400, Unit="mN*m")  % Nominal torque (max. continuous torque)
  % Max = Stall torque
  % Reference:
  % https://www.maxongroup.com/maxon/view/product/607325

x607325_RotOmgMax = Simulink.Parameter(2100)
x607325_TorqMax = Simulink.Parameter(13400, Unit="mN*m")

motorInfo = Simulink.Bus()
  Angle: double
  Speed: double
  Current: double

x607325_RotIner = Simulink.Parameter(5060, Unit="g*cm^2")  % Rotor inertia
  % Reference:
  % https://www.maxongroup.com/maxon/view/product/607325

x607325_CurrMinA = 0.83
x607325_PPR = Simulink.Parameter(4096, Unit="mN*m")  % Number of pulse per revolution, experimented